# Dynamo graph Home.dyn (Dynamo 2.16.2.5624)

# group: 1. COLECCION POR SELECCION
select_model_element = DSModelElementSelection()  # 1 picked in the model
select_model_elements = DSModelElementsSelection()  # 612 picked in the model
select_model_elements_by = DSModelElementsByCategorySelection("OST_Walls")  # "Select Model Elements By Category"; 9 picked in the model
select_model_elements_by_2 = DSModelElementsByCategorySelection("OST_StructuralColumns")  # "Select Model Elements By Category"; 30 picked in the model
# note: CASO MODELADO DE HOST
select_face = DSFaceSelection()  # 1 picked in the model
# note: CASO DE MODELADO DE UN ELEMENTO
select_edges = SelectEdges()  # 1 picked in the model
# note: MODELADO POR PUNTO EN ESPECIFICO
select_point_on_face = DSPointOnElementSelection()  # 1 picked in the model

# group: 2. COLECCION POR ID
code_block = CodeBlock { [512319,512394,512445,512449,512469,512473,512522,512526,1175183]; }
# note: ELEMENTOS POR ID
element_by_id = ElementById(Id=code_block)

# group: 3.2. TODOS LOS ELEMENTOS CATEGORIA
categories = Categories("OST_StructuralFoundation")
all_elements_of_category = ElementsOfCategory(Category=categories)

# group: 3.3.ELEMENTOS CATEGORIA - VISTA
categories_2 = Categories("OST_StructuralFoundation")
views = Views("{3D}")
# note: APARECIO EN REVIT 2023
all_elements_of_category_in_view = ElementsOfCategoryInView(Category=categories_2, View=views)

# group: 3.1 ELEMENTOS POR VISTA ACTIVA
all_elements_in_active_view = ElementsInView()

# group: 3.4 SELECCION POR TIPO
family_types = FamilyTypes("A1 metric:A1 metric")
all_elements_of_family_type = ElementsOfFamilyType(Family_Type=family_types)

# group: 3.5 SELECCION POR NIVEL
levels = Levels("Level 1")
all_elements_at_level = ElementsAtLevel(Level=levels)
