# Dynamo graph CLASE 08.dyn (Dynamo 2.16.2.5624)

# group: 1. Propiedades Elemento
select_model_element = DSModelElementSelection()  # 1 picked in the model
code_block = CodeBlock(A=select_model_element) { A.IsPinned; }
code_block_2 = CodeBlock(A=select_model_element) { A.UniqueId; }
code_block_3 = CodeBlock(A=select_model_element) { A.Quantity; }

# group: 2. Propiedades con python
python_script = Python(IN[0]=select_model_element)  # IronPython2
# ---------- python_script.python (10 lines) ----------
# Load the Python Standard and DesignScript Libraries
import sys
import clr
clr.AddReference('ProtoGeometry')
from Autodesk.DesignScript.Geometry import *

A = UnwrapElement(IN[0])


OUT = A.Quantity, A.TotalLength, A.GetHostId
# ----------------------------------------

code_block_4 = CodeBlock(A=select_model_element) { [A.IsPinned, A.Name]; }
all_elements_in_active_view = ElementsInView()
# note: PROPIEDAD COMO ELEMENTO
code_block_5 = CodeBlock(A=all_elements_in_active_view) { A.Category; }
# note: VARIOS A LA VEZ
python_script_2 = Python(IN[0]=all_elements_in_active_view)  # IronPython2
# ---------- python_script_2.python (14 lines) ----------
# Load the Python Standard and DesignScript Libraries
import sys
import clr
clr.AddReference('ProtoGeometry')
from Autodesk.DesignScript.Geometry import *

A = UnwrapElement(IN[0])
lista = []

for x in A:
	lista.append(x.Category)
	
	
OUT = lista
# ----------------------------------------

# group: 3. Propiedades con dynamo
name = Element.Name(element=select_model_element)
isPinned = Element.IsPinned(element=select_model_element)
id = Element.Id(element=select_model_element)
uniqueId = Element.UniqueId(element=select_model_element)
area = Space.Area()  # unwired: space
getCategory = Element.GetCategory(element=select_model_element)
