# Dynamo graph ID_V2.dyn (Dynamo 2.16.2.5624)

# group: Template
# note: Script realizado: Automatizacion de colocado de ID
# note: Descripción previa: Coloca descripción previa de nuestro script

# group: SELECCION EXTERNA
# note: Seleccionar / Importar datos que no pertenecen al archivo de Revit

# group: SELECCIÓN DATA MODELO
# Descripción <Haga doble clic aquí para editar la descripción del grupo>
# note: Seleccionamos elementos Revit

# group: REST LISTA
# note: Restructuración de listas

# group: DATOS DE ENTRADA (VARIABLES)
# Descripción <Haga doble clic aquí para editar la descripción del grupo>
# note: Variables como imputs : Texto, Booleano, Numeros, series, Variables

# group: INPUT DYNAMO PLAYER
# Descripción <Haga doble clic aquí para editar la descripción del grupo>
# note: Selección por usuario para Dynamo player

# group: FILTROS
# note: Filtrado de elementos

# group: VACEADO EXTERNO
# note: Exportacion de información a un programa externo

# group: VACEADO DE INFO
# Descripción <Haga doble clic aquí para editar la descripción del grupo>
# note: Exportación toda la gestionada a revit o Civil 3D

# group: EXPORTADO DE MODELO
# Descripción <Haga doble clic aquí para editar la descripción del grupo>
# note: Exportación de modelado a Revit o Civil 3D

# group: PROCESAMIENTO DE GEOMETRIA
# note: Operaciones con Geometria

# group: INPUT GEOMETRIA
# Descripción <Haga doble clic aquí para editar la descripción del grupo>
# note: Datos de entrada que requiera geometrias (CAD)

# group: Work in process
# note: WIP

# group: Información Grafica
# note: CREADO POR: Oscar Mendoza
# CREADO EN LA FECHA: 20/10/2024
# Version: 1.0
# ULTIMA EDICION: 21/09/2024
# VERSION REVIT: 23
# PACKAGES USADOS: Ninguno
# TESTEADO EN REVIT: 2021, 2022, 2023
# TESTEADO EN DYNAMO 2.02, 2.03 & 2.0.1
# TESTEADO EN DYNAMO PLAYER: YES

# group: ANOTACIONES
# Descripción <Haga doble clic aquí para editar la descripción del grupo>
code_block = CodeBlock { Lista_Habitaciones; }  # unwired: Lista_Habitaciones
code_block_2 = CodeBlock { ListaHabitaciones; }  # unwired: ListaHabitaciones

all_elements_in_active_view = ElementsInView()
code_block_3 = CodeBlock { "ID DE ELEMENTO"; }
id = Element.Id(element=all_elements_in_active_view)
string_from_object = FromObject(object=id)
setParameterByName = Element.SetParameterByName(element=all_elements_in_active_view, parameterName=code_block_3, value=string_from_object)
