# Dynamo graph R21-25_FloorBySelectedRoom.dyn "Suelos" (Dynamo 3.3.0.6316)

# group: Coleccion Habitaciones
# Descripción <Haga doble clic aquí para editar la descripción del grupo>
categories = Categories("OST_Rooms")
all_elements_of_category = ElementsOfCategory(Category=categories)

# group: Filtro por nivel
# Descripción <Haga doble clic aquí para editar la descripción del grupo>
code_block = CodeBlock { "Nivel"; }
# note: Obtener parametros
getParameterValueByName = Element.GetParameterValueByName(element=all_elements_of_category, parameterName=code_block)
nivel = Levels("Nivel 1")  # graph input
code_block_2 = CodeBlock(A=nivel) { A.Name; }
code_block_3 = CodeBlock(A=getParameterValueByName, B=code_block_2) { A==B; }
filterByBoolMask = List.FilterByBoolMask(list=all_elements_of_category, mask=code_block_3)

# group: Filtro por nombre
# Descripción <Haga doble clic aquí para editar la descripción del grupo>
code_block_4 = CodeBlock(A=filterByBoolMask.in) { A.Name; }
nombre_de_las_habitaciones = StringInput("Oficina")  # graph input
contains = String.Contains(string=code_block_4, searchFor=nombre_de_las_habitaciones)
filterByBoolMask_2 = List.FilterByBoolMask(list=filterByBoolMask.in, mask=contains)
finishBoundary = Room.FinishBoundary(room=filterByBoolMask_2.in)
tipo_de_piso = FloorTypes("Acabado_Ceramico")  # graph input
byOutlineTypeAndLevel = Floor.ByOutlineTypeAndLevel(outlineCurves=finishBoundary, floorType=tipo_de_piso, level=nivel)
