# Dynamo graph R21-25_FloorBySelectedRoom_UI.dyn (Dynamo 3.3.0.6316)
# packages: Data-Shapes 2025.3.119

code_block = CodeBlock { "Room2Floors"; }

# group: PRIMERA INTERFAZ
file_path = Filename("C:\Users\User\Downloads\fotolia_169457098.jpg")
code_block_2 = CodeBlock { "Room2Floors"; }
code_block_3 = CodeBlock { "OK"; "CANCELAR"; }
code_block_4 = CodeBlock { "Seleccione Nivel"; }
categories = Categories("OST_Levels")
all_elements_of_category = ElementsOfCategory(Category=categories)
code_block_5 = CodeBlock(A=all_elements_of_category) { A.Name; }
dropdown_data = Custom[DropDown Data](InputName=code_block_4, Keys=code_block_5, Values=all_elements_of_category)  # package Data-Shapes; Create data for DropDown input in UI.MultiInputForm ++ . Check out www.data-shapes.net for more infos.
list_create = List.Create(item0=dropdown_data)
boolean = BoolSelector(true)
code_block_6 = CodeBlock { "https://www.youtube.com/@mendozaballenabim"; }
code_block_7 = CodeBlock { 300; }
multipleinputform = Custom[MultipleInputForm ++](Description_optional=code_block_2, Logo_optional=file_path, ButtonText_optional=code_block_3.out0, list_create, Toggle=boolean, LinkToHelp_optional=code_block_6, CancelButtonText_optional=code_block_3.out1, LabelWidth_optional=code_block_7)  # package Data-Shapes; Create a form with multiple inputs. see www.data-shapes.net for tutorials and infos!

code_block_8 = CodeBlock { "OK"; "CANCELAR"; }
code_block_9 = CodeBlock { "Selecciona los ambientes"; }

# group: PRIMERA
categories_2 = Categories("OST_Rooms")
# note: 1. Filtramos los rooms x Nivel
# 2. Filtramos x Nombre de ambiente
# 3. Obtenemos la geometria
# 4. Modelamos
all_elements_of_category_2 = ElementsOfCategory(Category=categories_2)
code_block_10 = CodeBlock { "Level"; }
getParameterValueByName = Element.GetParameterValueByName(element=all_elements_of_category_2, parameterName=code_block_10)
# note: ENTRADA 1
resultado_primera_interfaz = CodeBlock(A=multipleinputform.User_Inputs) { A[0]; }
code_block_11 = CodeBlock(A=resultado_primera_interfaz) { A.Name; }
code_block_12 = CodeBlock(A=getParameterValueByName, B=code_block_11) { A == B; }
filterByBoolMask = List.FilterByBoolMask(list=all_elements_of_category_2, mask=code_block_12)

code_block_13 = CodeBlock(A=filterByBoolMask.in) { A.Name; }
listview_data = Custom[Listview Data](InputName=code_block_9, Keys=code_block_13, Values=filterByBoolMask.in)  # package Data-Shapes; Create data for ListView input in UI.MultiInputForm ++ . Check out www.data-shapes.net for more infos.
code_block_14 = CodeBlock { "Seleccione el tipo de suelo"; }
categories_3 = Categories("OST_Floors")
code_block_15 = CodeBlock(A=categories_3) { A.Name; }
python_script = Python(IN[0]=code_block_15)  # IronPython2
# ---------- python_script.python (42 lines) ----------
import clr

clr.AddReference('RevitAPI')
from Autodesk.Revit.DB import *
from Autodesk.Revit.DB.Structure import *

clr.AddReference('RevitAPIUI')
from Autodesk.Revit.UI import *

clr.AddReference('System')
from System.Collections.Generic import List

clr.AddReference('RevitNodes')
import Revit
clr.ImportExtensions(Revit.GeometryConversion)
clr.ImportExtensions(Revit.Elements)

clr.AddReference('RevitServices')
import RevitServices
from RevitServices.Persistence import DocumentManager
from RevitServices.Transactions import TransactionManager

doc = DocumentManager.Instance.CurrentDBDocument
uidoc=DocumentManager.Instance.CurrentUIApplication.ActiveUIDocument

texto_filtro = IN[0]

techos = FilteredElementCollector(doc).OfCategory(BuiltInCategory.OST_Ceilings).WhereElementIsElementType().ToElements()
pisos = FilteredElementCollector(doc).OfCategory(BuiltInCategory.OST_Floors).WhereElementIsElementType().ToElements()
pilares = FilteredElementCollector(doc).OfCategory(BuiltInCategory.OST_StructuralColumns).WhereElementIsElementType().ToElements()

if texto_filtro == "Floors":
    salida = pisos
elif texto_filtro == "Ceilings":
    salida = techos
elif texto_filtro == "Structural Columns":
    salida = pilares
else:
    salida = "Categoria no disponible en libreria. Revisar"


OUT = salida
# ----------------------------------------
code_block_16 = CodeBlock(A=python_script) { A.Name; }
dropdown_data_2 = Custom[DropDown Data](InputName=code_block_14, Keys=code_block_16, Values=python_script)
list_create_2 = List.Create(item0=listview_data, item1=dropdown_data_2)
boolean_2 = BoolSelector(true)
code_block_17 = CodeBlock { "https://www.youtube.com/@mendozaballenabim"; }
code_block_18 = CodeBlock { 300; }
multipleinputform_2 = Custom[MultipleInputForm ++](Description_optional=code_block, Logo_optional=file_path, ButtonText_optional=code_block_8.out0, list_create_2, Toggle=boolean_2, LinkToHelp_optional=code_block_17, CancelButtonText_optional=code_block_8.out1, LabelWidth_optional=code_block_18)
code_block_19 = CodeBlock(A=multipleinputform_2.User_Inputs) { A[0]; A[1]; }
code_block_20 = CodeBlock { "Fl"; }
finishBoundary = Room.FinishBoundary(room=code_block_19.out0)
flatten = List.Flatten(list=finishBoundary@L2)
byOutlineTypeAndLevel = Floor.ByOutlineTypeAndLevel(outlineCurves=flatten, floorType=code_block_19.out1, level=resultado_primera_interfaz)
setParameterByName = Element.SetParameterByName(element=code_block_19.out0, parameterName=code_block_20, value=byOutlineTypeAndLevel)
