# Dynamo graph R25_SoladosCimentaciones.dyn "R25_SoladosZapatas" (Dynamo 2.16.4.10216)
# packages: Data-Shapes 2025.3.119, Data-Shapes 2023.2.112

code_block = CodeBlock { "AutoSol"; }
file_path = Filename("C:\Users\oscar\Desktop\default-1768083270.jpg")
code_block_2 = CodeBlock { "OK"; "CANCELAR"; }
code_block_3 = CodeBlock { "Seleccionar cimentaciones"; }
code_block_4 = CodeBlock { "Realizar"; }
categories = Categories("OST_StructuralFoundation")
selectmodelelements_data = Custom[SelectModelElements Data](InputName=code_block_3, ButtonText=code_block_4, CategoryFilter=categories)  # package Data-Shapes; Creates a Revit element selection input for UI.MultipleInputForm++ . Check out www.data-shapes.net for more infos!
code_block_5 = CodeBlock { "Seleccionar el nivel"; }
categories_2 = Categories("OST_Levels")
all_elements_of_category = ElementsOfCategory(Category=categories_2)
code_block_6 = CodeBlock(A=all_elements_of_category) { A.Name; }
dropdown_data = Custom[DropDown Data](InputName=code_block_5, Keys=code_block_6, Values=all_elements_of_category)  # package Data-Shapes; Create data for DropDown input in UI.MultiInputForm ++ . Check out www.data-shapes.net for more infos.
code_block_7 = CodeBlock { "Seleccionar el tipo de suelo"; }
categories_3 = Categories("OST_Floors")
code_block_8 = CodeBlock(A=categories_3) { A.Name; }
python_script = Python(IN[0]=code_block_8)  # CPython3
# ---------- python_script.python (42 lines) ----------
import clr

clr.AddReference('RevitAPI')
from Autodesk.Revit.DB import *
from Autodesk.Revit.DB.Structure import *

clr.AddReference('RevitAPIUI')
from Autodesk.Revit.UI import *

clr.AddReference('System')
from System.Collections.Generic import List

clr.AddReference('RevitNodes')
import Revit
clr.ImportExtensions(Revit.GeometryConversion)
clr.ImportExtensions(Revit.Elements)

clr.AddReference('RevitServices')
import RevitServices
from RevitServices.Persistence import DocumentManager
from RevitServices.Transactions import TransactionManager

doc = DocumentManager.Instance.CurrentDBDocument
uidoc=DocumentManager.Instance.CurrentUIApplication.ActiveUIDocument

texto_filtro = IN[0]

techos = FilteredElementCollector(doc).OfCategory(BuiltInCategory.OST_Ceilings).WhereElementIsElementType().ToElements()
pisos = FilteredElementCollector(doc).OfCategory(BuiltInCategory.OST_Floors).WhereElementIsElementType().ToElements()
pilares = FilteredElementCollector(doc).OfCategory(BuiltInCategory.OST_StructuralColumns).WhereElementIsElementType().ToElements()

if texto_filtro == "Floors" or texto_filtro == "Suelos" :
    salida = pisos
elif texto_filtro == "Ceilings" or texto_filtro == "Techos":
    salida = techos
elif texto_filtro == "Structural Columns" or texto_filtro == "Pilares estructurales":
    salida = pilares
else:
    salida = "Categoria no disponible en libreria. Revisar"


OUT = salida
# ----------------------------------------
code_block_9 = CodeBlock(A=python_script) { A.Name; }
dropdown_data_2 = Custom[DropDown Data](InputName=code_block_7, Keys=code_block_9, Values=python_script)
code_block_10 = CodeBlock { "Nota"; }
code_block_11 = CodeBlock()
# ---------- code_block_11.designscript (2 lines) ----------
"Modela de modela automatizada la capa de concreto simple desde seleccion de zapatas.
Realizado por Oscar Mendoza Ballena OMBIM";
# ----------------------------------------
textnote_data = Custom[TextNote Data](Title=code_block_10, TextNote=code_block_11)  # package Data-Shapes; Create Data for TextNote input in UI.MultipleInputForm ++ . Check out www.data-shapes.net for more informations
list_create = List.Create(item0=selectmodelelements_data, item1=dropdown_data, item2=dropdown_data_2, item3=textnote_data)
boolean = BoolSelector(true)
code_block_12 = CodeBlock { 200; }
multipleinputform = Custom[MultipleInputForm ++](Description_optional=code_block, Logo_optional=file_path, ButtonText_optional=code_block_2.out0, list_create, Toggle=boolean, CancelButtonText_optional=code_block_2.out1, LabelWidth_optional=code_block_12)  # package Data-Shapes; Create a form with multiple inputs. see www.data-shapes.net for tutorials and infos!
code_block_13 = CodeBlock(A=multipleinputform.User_Inputs) { A[0]; A[1]; A[2]; }
geometry = Element.Geometry(element=code_block_13.out0)
explode = Geometry.Explode(geometry=geometry)
flatten = List.Flatten(list=explode)
code_block_14 = CodeBlock { 0.5; }
pointAtParameter = Surface.PointAtParameter(surface=flatten, u=code_block_14, v=code_block_14)
normalAtPoint = Surface.NormalAtPoint(surface=flatten, point=pointAtParameter)
code_block_15 = CodeBlock(A=normalAtPoint) { A.Z; }
code_block_16 = CodeBlock { 1; }
round = Math.Round(number=code_block_15, digits=code_block_16)
code_block_17 = CodeBlock(A=round) { A<0; }
filterByBoolMask = List.FilterByBoolMask(list=flatten, mask=code_block_17)
code_block_18 = CodeBlock(CARA_INFERIOR=filterByBoolMask.in) { CARA_INFERIOR; }
perimeterCurves = Surface.PerimeterCurves(surface=code_block_18)
byJoinedCurves = PolyCurve.ByJoinedCurves(curves=perimeterCurves)
byOutlineTypeAndLevel = Floor.ByOutlineTypeAndLevel(outline=byJoinedCurves, floorType=code_block_13.out2, level=code_block_13.out1)
