# Dynamo graph Clase16.dyn (Dynamo 3.3.0.6316)

# note: EJEMPLAR/INSTANCE
select_model_elements_by = DSModelElementsByCategorySelection("OST_Rooms")  # "Select Model Elements By Category"; 8 picked in the model
python_script = Python(IN[0]=select_model_elements_by)  # CPython3
# ---------- python_script.python (37 lines) ----------
import clr

clr.AddReference('RevitAPI')
from Autodesk.Revit.DB import *
from Autodesk.Revit.DB.Structure import *

clr.AddReference('RevitAPIUI')
from Autodesk.Revit.UI import *

clr.AddReference('System')
from System.Collections.Generic import List

clr.AddReference('RevitNodes')
import Revit
clr.ImportExtensions(Revit.GeometryConversion)
clr.ImportExtensions(Revit.Elements)

clr.AddReference('RevitServices')
import RevitServices
from RevitServices.Persistence import DocumentManager
from RevitServices.Transactions import TransactionManager

doc = DocumentManager.Instance.CurrentDBDocument
uidoc=DocumentManager.Instance.CurrentUIApplication.ActiveUIDocument

#Preparing input from dynamo to revit
elements = UnwrapElement(IN[0])

result_Names = []
result_FloorFinish = []
for elem in elements:
    paramName = elem.get_Parameter(BuiltInParameter.ROOM_NAME).AsValueString()
    paramFloorFinish = elem.get_Parameter(BuiltInParameter.ROOM_FINISH_WALL).AsValueString()
    result_Names.append(paramName)
    result_FloorFinish.append(paramFloorFinish)

OUT = result_Names, result_FloorFinish
# ----------------------------------------
# note: TIPO/TYPE
select_model_elements_by_2 = DSModelElementsByCategorySelection("OST_Doors")  # "Select Model Elements By Category"; 7 picked in the model
elementType = Element.ElementType(element=select_model_elements_by_2)
python_script_2 = Python(IN[0]=elementType)  # CPython3
# ---------- python_script_2.python (37 lines) ----------
import clr

clr.AddReference('RevitAPI')
from Autodesk.Revit.DB import *
from Autodesk.Revit.DB.Structure import *

clr.AddReference('RevitAPIUI')
from Autodesk.Revit.UI import *

clr.AddReference('System')
from System.Collections.Generic import List

clr.AddReference('RevitNodes')
import Revit
clr.ImportExtensions(Revit.GeometryConversion)
clr.ImportExtensions(Revit.Elements)

clr.AddReference('RevitServices')
import RevitServices
from RevitServices.Persistence import DocumentManager
from RevitServices.Transactions import TransactionManager

doc = DocumentManager.Instance.CurrentDBDocument
uidoc=DocumentManager.Instance.CurrentUIApplication.ActiveUIDocument

#Preparing input from dynamo to revit
elements = UnwrapElement(IN[0])

result_altura = []
result_nombres = []
for elem in elements:
    paramAltura = elem.get_Parameter(BuiltInParameter.FAMILY_HEIGHT_PARAM).AsValueString()
    paramNombres = elem.get_Parameter(BuiltInParameter.ALL_MODEL_TYPE_NAME).AsValueString()
    result_altura.append(paramAltura)
    result_nombres.append(paramNombres)

OUT = result_nombres, result_altura
# ----------------------------------------
