# Dynamo graph CREACION COLUMNAS.dyn (Dynamo 2.19.3.6394)

# note: AAA

categories = Categories("OST_Grids")
all_elements_of_category = ElementsOfCategory(Category=categories)
code_block = CodeBlock { "A".."Z"; }
code_block_2 = CodeBlock { "Nombre"; }
getParameterValueByName = Element.GetParameterValueByName(element=all_elements_of_category, parameterName=code_block_2)
indexOf = List.IndexOf(list=code_block, element=getParameterValueByName)
code_block_3 = CodeBlock(A=indexOf) { A!=-1; }

# group: GEOMETRIA INTERSECTADA
# Descripción <Haga doble clic aquí para editar la descripción del grupo>
filterByBoolMask = List.FilterByBoolMask(list=all_elements_of_category, mask=code_block_3)
code_block_4 = CodeBlock(A=filterByBoolMask.in) { A.Name; }
code_block_5 = CodeBlock(A=filterByBoolMask.out) { A.Name; }
curve = Grid.Curve(grid=filterByBoolMask.in)
# note: ENTRADA NO TOCAR
curve_2 = Grid.Curve(grid=filterByBoolMask.out)
intersect = Geometry.Intersect(geometry=curve, other=curve_2, lacing=CrossProduct)

altura_columna = DoubleInput(3)  # graph input
translate = Geometry.Translate(geometry=intersect, zTranslation=altura_columna)
byStartPointEndPoint = Line.ByStartPointEndPoint(startPoint=intersect, endPoint=translate)
NIVEL = Levels("01 - Entry Level")  # graph input
tipo_de_columna = StructuralColumnTypes("PLACA EN T_CONCRETO F'C=280 kg/cm²_0.75X0.60m_e=0.30m")  # graph input
columnByCurve = StructuralFraming.ColumnByCurve(curve=byStartPointEndPoint, level=NIVEL, structuralColumnType=tipo_de_columna)
